# Grasshopper definition hugad_device_v0.0.ghx (Grasshopper 1.0.8)
# Copyright: 2024
# plug-ins: RhinoCodePluginGH, MeshEdit Components, Pufferfish, SurfacePlus

pt = ConstructPoint(XCoordinate=0, YCoordinate=0, ZCoordinate=0)
pt_2 = ConstructPoint(XCoordinate=0, YCoordinate=Slider(24, range=0..100), ZCoordinate=Slider(113, range=0..1000))
ln = Line(StartPoint=pt, EndPoint=pt_2)
number_slider = Slider(4, range=0..100)
eval = EvaluateCurve(Curve=reparameterize(ln), Parameter=Slider(0.712, range=0..1))  # -> Point, Tangent, Angle
Y = UnitY(Factor=Slider(8.835, range=0..100))
move = Move(Geometry=eval.Point, Motion=expr("-x", Y))  # -> Geometry, Transform
range = Range(Domain=Domain(0, 1), Steps=number_slider)
arc = Arc3Pt(PointA=pt, PointB=move.Geometry, PointC=pt_2)  # -> Arc, Plane, Radius
pframe = PerpFrame(Curve=reparameterize(arc.Arc), Parameter=range)
pframe_2 = PerpFrame(Curve=reparameterize(arc.Arc), Parameter=Slider(0.5, range=0..1))
X = UnitX(Factor=1)
align = AlignPlane(Plane=pframe, Direction=X)  # -> Plane, Angle

length_start = Slider(85, range=0..100)
length_width_end = Slider(15, range=0..100)
width_start = Slider(25, range=0..100)
# Plane
# Length range
# Width range
# Steps
# X segments
# Y Segments
# Bend
# Bend Graph
# Chamfer
# Inner convexity
dom = ConstructDomain(DomainStart=length_start, DomainEnd=length_width_end)
dom_2 = ConstructDomain(DomainStart=width_start, DomainEnd=length_width_end)

inner_convexity = Slider(11.14, range=0..100)
chamfer_start = Slider(7, range=0..100)
chamfer_end = Slider(3.82, range=0..100)

bend = Slider(10.46, range=0..100)
y_segements = Slider(1, range=1..10)
x_segements = Slider(3, range=1..100)
range_2 = Range(Domain=Domain(1, 0), Steps=number_slider)
graph = GraphMapper(range_2, x0=0, x1=1, y0=0, y1=1, container_name="Bezier", cpx=[0, 0.25, 0.75, 1], cpy=[0, 0.25, 0.75, 1])

graph_2 = GraphMapper(range_2, x0=0, x1=1, y0=0, y1=1, container_name="Gaussian", factor=0.2649286389, mean=0.5014343262, sdev=0.1127069592)
dom_3 = ConstructDomain(DomainStart=inner_convexity, DomainEnd=0)
dom_4 = ConstructDomain(DomainStart=chamfer_start, DomainEnd=chamfer_end)
remap = RemapNumbers(Value=graph_2, Source=Domain(1, 0), Target=dom_3)  # -> Mapped, Clipped
range_3 = Range(Domain=dom_4, Steps=number_slider)  # -> graft(Range)
entwine = Entwine(
    Branch00=align.Plane,
    Branch01=dom,
    Branch02=dom_2,
    Branch03=number_slider,
    Branch04=x_segements,
    Branch05=y_segements,
    Branch06=bend,
    Branch07=graph,
    Branch08=range_3,
    Branch09=remap.Mapped,
    FlattenInputs=True)
output = DataOutput(
    DataInput=entwine,
    Destination="G:\#Design\3D Modeling\Hugad\hugad_versions\type1_data.ghdata",
    RelativePath="G:\#Design\3D Modeling\Hugad\hugad_versions\type1_data.ghdata|type1_data.ghdata")
input = DataInput(
    Destination="G:\#Design\3D Modeling\Hugad\hugad_versions\type1_data.ghdata",
    RelativePath="G:\#Design\3D Modeling\Hugad\hugad_versions\type1_data.ghdata|type1_data.ghdata",
    UpdateDelay=5)
bang = ExplodeTree(Data=input)  # -> Branch0, Branch1, Branch2, Branch3, Branch4, Branch5, Branch6, Branch7, graft(Branch8), Branch9
cluster = Cluster(
    plane=bang.Branch0,
    length_range=bang.Branch1,
    width_range=bang.Branch2,
    steps=bang.Branch3,
    x_segements=bang.Branch4,
    y_segements=bang.Branch5,
    bend=bang.Branch6,
    bend_graph=bang.Branch7,
    chamfer=bang.Branch8,
    inner_convexity=bang.Branch9)  # -> segment_points, middle_polyline
pline = PolyLine(Vertices=cluster.segment_points, Closed=True)  # -> flatten(Polyline)
item = ListItem(List=flatten(cluster.middle_polyline), Index=0, Wrap=True)  # -> Item1, Item
deplane = DeconstructPlane(Plane=bang.Branch0)  # -> Origin, XAxis, YAxis, ZAxis
tstat = TreeStatistics(Tree=cluster.segment_points)  # -> Paths, Length, Count
item_2 = ListItem(List=tstat.Paths, Index=0, Wrap=True)  # -> Item1, Item
item_3 = ListItem(List=deplane.ZAxis, Index=0, Wrap=True)  # -> Item1, Item
shift = ShiftList(List=cluster.segment_points, Shift=Slider(2, range=0..10), Wrap=True)
branch = TreeBranch(Tree=cluster.segment_points, Path=item_2.Item, MaintainPaths=True)
branch_2 = TreeBranch(Tree=cluster.segment_points, Path=item_2.Item1, MaintainPaths=True)
subset = SubList(List=reverse(shift), Domain=Slider(7, range=0..10), Wrap=True)  # -> List, Index
number_slider_2 = Slider(3.37, range=0..10)
number_slider_3 = Slider(3, range=0..10)
pline_2 = PolyLine(Vertices=subset.List, Closed=False)  # -> flatten(Polyline)
paramloftmsh = ParameterLoftMesh(
    Sections=pline_2,
    ParametersU=[0, 0.1, 0.2, 0.3, 0.4, 0.5, 0.6, 0.7, 0.8, 0.9, 1],
    ParametersV=[0, 1],
    Weighted=False,
    Lengths=True,
    Angle=0,
    Closed=False,
    Triangulate=False)
flipm = FlipMesh(Mesh=paramloftmsh, VertexNormals=True, FaceNormals=True, FaceOrientation=True)
subdmesh = SubDFromMesh(Mesh=flipm, Creases=1, Corners=1, Interpolate=False)
number_slider_4 = Slider(1.391, range=0..10)
neg = Negative(Value=number_slider_3)
subd_to_nurbs = Python3Script(S=subdmesh, Ex=Slider(4, range=0..10))  # -> B; inputs Ex: Int32
#   port Ex: None = 0 LocalG1 = 1 LocalG2 = 2 LocalG1x = 3 LocalG1xx = 4
# ---------- subd_to_nurbs: Python ----------
import Rhino.Geometry as rg
if Ex > 4:
    raise ValueError('This option doesn\'nt exist. (0, 4)')
opt = rg.SubDToBrepOptions()
opt.PackFaces = True
evp = rg.SubDToBrepOptions.ExtraordinaryVertexProcessOption(Ex)
opt.ExtraordinaryVertexProcess = evp
B = S.ToBrep(opt)
# ---------- end subd_to_nurbs ----------
cluster_2 = Cluster_2(edge_points=branch_2, edge_vector=item_3.Item1, chamfer=number_slider_2)
cluster_3 = Cluster_2(edge_points=branch, edge_vector=item_3.Item, chamfer=neg)
addition = Addition(A=number_slider_4, B=number_slider_2, C=number_slider_3)
addition_2 = Addition(A=number_slider_2, B=number_slider_4)
shift_2 = ShiftList(List=cluster_3, Shift=1, Wrap=True)
entwine_2 = Entwine(Branch00=cluster_2, Branch01=cluster_3, FlattenInputs=True)
amp = Amplitude(Vector=item_3.Item1, Amplitude=addition_2)
amp_2 = Amplitude(Vector=item_3.Item, Amplitude=neg)
pline_3 = PolyLine(Vertices=shift_2, Closed=True)
points = PointList(Points=shift_2, Size=2.35)
disc = Discontinuity(Curve=pline_3, Level=1)  # -> Points, Parameters
move_2 = Move(Geometry=item.Item, Motion=amp_2)  # -> Geometry, Transform
move_3 = Move(Geometry=item.Item1, Motion=amp)  # -> Geometry, Transform

c_script = CSharpScript()  # -> Faces
# ---------- c_script: C# ----------
// Grasshopper Script Instance
#region Usings
using System;
using System.Linq;
using System.Collections;
using System.Collections.Generic;
using System.Drawing;

using Rhino;
using Rhino.Geometry;

using Grasshopper;
using Grasshopper.Kernel;
using Grasshopper.Kernel.Data;
using Grasshopper.Kernel.Types;
#endregion

public class Script_Instance : GH_ScriptInstance
{
    #region Notes
    /* 
      Members:
        RhinoDoc RhinoDocument
        GH_Document GrasshopperDocument
        IGH_Component Component
        int Iteration

      Methods (Virtual & overridable):
        Print(string text)
        Print(string format, params object[] args)
        Reflect(object obj)
        Reflect(object obj, string method_name)
    */
    #endregion

    private void RunScript(object V, ref object Faces)
    {
        // Write your logic here
        Console.WriteLine("Hello!");
        
    }
}
# ---------- end c_script ----------
face_indices = Python3Script(V=disc.Points)  # -> Faces; inputs V: list of Point3d
# ---------- face_indices: Python ----------
from math import ceil
face_n = int((len(V)-2)/2)

n = [i for i in range(len(V))]
Faces = []
for i in range(face_n):
    cb = '{}'
    ch = f'Q{cb[0]}{n[0]};{n[1]};{n[-2]};{n[-1]}{cb[1]}'
    Faces.append(ch)
    n.pop(-1)
    n.pop(0)

print(Faces)
# ---------- end face_indices ----------

pline_4 = PolyLine(Vertices=entwine_2, Closed=True)  # -> flatten(Polyline)
conmesh = ConstructMesh(Vertices=disc.Points, Faces=face_indices)
merge = Merge(Data1=move_3.Geometry, Data2=move_2.Geometry)
entwine_3 = Entwine(Branch00=move_3.Geometry, FlattenInputs=True)
ins = InsertItems(List=pline, Item=pline_4, Indices=[-1, 0], Wrap=True)
ins_2 = InsertItems(List=flatten(cluster.middle_polyline), Item=merge, Indices=[-1, 0], Wrap=True)
midpt = CurveMiddle(Curve=entwine_3)
paramloftmsh_2 = ParameterLoftMesh(
    Sections=ins,
    ParametersU=[0, 0.1, 0.2, 0.3, 0.4, 0.5, 0.6, 0.7, 0.8, 0.9, 1],
    ParametersV=[0, 1],
    Weighted=False,
    Lengths=True,
    Angle=0,
    Closed=False,
    Triangulate=False)
py3 = Python3Script(cen=graft(midpt), pts=cluster_2)  # -> a; inputs cen: Point3d, pts: list of Point3d
# ---------- py3: Python ----------
import Rhino.Geometry as rg 

a = rg.Mesh()
pts.append(pts[0])
for i in range(len(pts) - 1):
    pl = rg.Polyline()
    pl.Add(cen)
    pl.Add(pts[i])
    pl.Add(pts[i + 1])
    pl.Add(cen)
    mesh = rg.Mesh.CreateFromClosedPolyline(pl)
    a.Append(mesh)
a.Weld(0.01)
# ---------- end py3 ----------
mjoin = MeshJoin(Meshes=flatten([paramloftmsh_2, py3, conmesh]))
weldvertices = MeshWeldVertices(Mesh=mjoin, Tolerance=0.01)  # -> RuntimeMessage, Mesh
unim = UnifyMesh(Mesh=weldvertices.Mesh)  # -> Result, Count
subdmesh_2 = SubDFromMesh(Mesh=unim.Result, Creases=1, Corners=1, Interpolate=False)
# Inside surface
offmsh = OffsetMesh(Mesh=unim.Result, Distance=expr("-x", 1), BothSides=0, CreateSolid=False)
subdpoly = SubDControlPolygon(SubD=subdmesh_2)
subdmesh_3 = SubDFromMesh(Mesh=offmsh, Creases=1, Corners=1, Interpolate=False)
medges = MeshEdges(Mesh=subdpoly)  # -> NakedEdges, InteriorEdges, NonManifoldEdges

# ---- group: Calculate Dimensions
bbox = BoundingBox(Content=subdmesh_2, Plane=pframe_2)  # -> Box, Box_2
edges = BrepEdges(Brep=bbox.Box)  # -> Naked, Interior, NonManifold
py3_2 = Python3Script(B=bbox.Box)  # -> pts, U, V, W; inputs B: Box
# ---------- py3_2: Python ----------
import Rhino.Geometry as rg
pts = B.GetCorners()
U = B.X[1] - B.X[0]
V = B.Y[1] - B.Y[0]
W = B.Z[1] - B.Z[0]
# ---------- end py3_2 ----------
item_4 = ListItem(List=py3_2.pts, Index=0, Wrap=True)  # -> Item, Item1, Item2, Item3, Item4
ln_2 = Line(StartPoint=item_4.Item, EndPoint=item_4.Item1)
ln_3 = Line(StartPoint=item_4.Item, EndPoint=item_4.Item4)
ln_4 = Line(StartPoint=item_4.Item1, EndPoint=item_4.Item2)

# ----
preview = CustomPreview(Geometry=edges.Interior, Material="white")
linedim = LineDimension(Line=[ln_2, ln_4, ln_3], Text="{0:0.00}", Size=Slider(2.25, range=0..10))
subtraction = Subtraction(A=1, B=Slider(0.16, range=0..1))
shrink = ShrinkSurface(Brep=subd_to_nurbs)  # -> Brep, Surface

number_slider_5 = Slider(0.37, range=0..1)
subtraction_2 = Subtraction(A=1, B=number_slider_5)
dom_5 = ConstructDomain(DomainStart=number_slider_5, DomainEnd=subtraction_2)
dom_6 = ConstructDomain(DomainStart=Slider(0.24, range=0..1), DomainEnd=subtraction)
dom² = ConstructDomain²(DomainU=dom_5, DomainV=dom_6)
subsrf = Isotrim(Surface=reparameterize(shrink.Surface), Domain=dom²)
rebuild = Rebuild(Surface=subsrf, DegreeU=3, DegreeV=3, CountU="10", CountV="10")

dim = Dimensions(Surface=subsrf)  # -> UDimension, VDimension
panel = Panel("""68.279582
30.147349""")
panel_2 = Panel(dim.VDimension)
panel_3 = Panel(dim.UDimension)
sdivide = DivideSurface(Surface=rebuild, UCount=Slider(3, range=0..100), VCount=Slider(6, range=0..100))  # -> Points, Normals, Parameters
flip = FlipMatrix(Data=sdivide.Points)
intcrv = Interpolate(Vertices=flip, Degree=3, Periodic=False, KnotStyle=1)  # -> Curve, Length, Domain
number_slider_6 = Slider(5, range=0..10)
multiplication = Multiplication(A=number_slider_6, B=2)
len = Length(Curve=intcrv.Curve)
addition_3 = Addition(A=multiplication, B=Slider(2.1, range=0..10))
division = Division(A=len, B=addition_3)
int = Integer(division)
divide = DivideCurve(Curve=intcrv.Curve, Count=int, Kinks=False)  # -> Points, Tangents, Parameters
srf_cp = SurfaceClosestPoint(Point=divide.Points, Surface=rebuild)  # -> Point, UVPoint, Distance
evalsrf = EvaluateSurface(Surface=rebuild, Point=srf_cp.UVPoint)  # -> Point, Normal, UDirection, VDirection, Frame
sph = Sphere(Base=evalsrf.Point, Radius=number_slider_6)
cir = Circle(Plane=evalsrf.Frame, Radius=number_slider_6)
srfsplit = SurfaceSplit(Surface=graft(sph), Curves=graft(cir))
item_5 = ListItem(List=srfsplit, Index=0, Wrap=True)
pshift = ShiftPaths(Data=item_5, Offset=-2)  # -> simplify(Data)
cyl = Cylinder(Base=evalsrf.Frame, Radius=number_slider_6, Length=expr("-x", Slider(4.65, range=0..10)))
scale_nu = ScaleNU(Geometry=pshift, Plane=simplify(evalsrf.Frame), ScaleX=1, ScaleY=1, ScaleZ=Slider(0.2, range=0..1))  # -> Geometry, Transform
weave = Weave(Pattern=[0, 1], Stream0=graft(cyl), Stream1=graft(scale_nu.Geometry), NullGaps=False)
join = BrepJoin(Breps=weave)  # -> Breps, Closed
pshift_2 = ShiftPaths(Data=join.Breps, Offset=-2)  # -> simplify(Data)

preview_2 = CustomPreview(Geometry=flatten([subdmesh_2, subdmesh_3, pshift_2]), Material=ColourSwatch(SwatchColor=RGB(186, 52, 139)))
curve_preview = CustomCurvePreview(Curve=medges.InteriorEdges, Colour=RGB(0, 0, 0))
preview_3 = CustomPreview(Material=ColourSwatch(SwatchColor=RGBA(255, 255, 255, 32)))

panel_4 = Panel(pshift_2)

# ==== cluster Cluster
inner_convexity = ClusterInput()
length_range = ClusterInput()
width_range = ClusterInput()
x_segements = ClusterInput()
y_segements = ClusterInput()
bend_graph = ClusterInput()
chamfer = ClusterInput()
plane = ClusterInput()
steps = ClusterInput()
bend = ClusterInput()
range = Range(Domain=width_range, Steps=steps)
dom = ConstructDomain(DomainStart=bend, DomainEnd=0)
range_2 = Range(Domain=length_range, Steps=steps)
division = Division(A=range_2, B=2)
deplane = DeconstructPlane(Plane=plane)  # -> Origin, XAxis, YAxis, ZAxis
X = UnitX(Factor=division)
remap = RemapNumbers(Value=bend_graph, Source=Domain(1, 0), Target=dom)  # -> Mapped, Clipped
parabola = Python3Script(N=x_segements, D="1", Inv="1")  # -> R; inputs N: Int32, D: Int32, Inv: Boolean
#   port N: Number of steps
#   port D: 0 = (0 To 1) 1 = (-1 To 1)
# ---------- parabola: Python ----------
if not N:
    N = 10

types = [(0, 1),
         (-1, 1)]
R = []
start, end = types[D]
diff = end - start
step = diff / N
N += 1
for i in range(N):
    f = (start + i * step) ** 2
    if Inv:
        R.append(end - f)
    else:
        R.append(f)
# ---------- end parabola ----------
multiplication = Multiplication(A=parabola, B=graft(remap.Mapped))
move = Move(Geometry=plane, Motion=expr("-x", X))  # -> Geometry, Transform
move_2 = Move(Geometry=plane, Motion=X)  # -> Geometry, Transform
multiplication_2 = Multiplication(A=graft(deplane.YAxis), B=multiplication)
ln = Line(StartPoint=move.Geometry, EndPoint=move_2.Geometry)
neg = Negative(Value=multiplication_2)
divide = DivideCurve(Curve=ln, Count=x_segements, Kinks=False)  # -> Points, Tangents, Parameters
move_3 = Move(Geometry=divide.Points, Motion=neg)  # -> Geometry, Transform
parabola_2 = Python3Script(N=x_segements, D="1", Inv="1")  # -> R; inputs N: Int32, D: Int32, Inv: Boolean; same code as parabola
pline = PolyLine(Vertices=move_3.Geometry, Closed=False)
multiplication_3 = Multiplication(A=parabola_2, B=graft(inner_convexity))
multiplication_4 = Multiplication(A=graft(deplane.YAxis), B=multiplication_3)
middle_polyline = ClusterOutput(pline)
offset = OffsetCurve(Curve=pline, Distance=expr("x/2", graft(range)), Plane=graft(plane), Corners=1)
offset_2 = OffsetCurve(Curve=pline, Distance=expr("-x/2", graft(range)), Plane=graft(plane), Corners=1)
end = EndPoints(Curve=offset)  # -> Start, End
end_2 = EndPoints(Curve=offset_2)  # -> Start, End
ln_2 = Line(StartPoint=end.Start, EndPoint=end_2.Start)
ln_3 = Line(StartPoint=end.End, EndPoint=end_2.End)
trim_curve = TrimCurve(C=offset, D=chamfer)  # -> Crv; inputs C: Curve, D: Double, E: Int32
#   port E: None = 0 Start = 1 End = 2 Both = 3
# ---------- trim_curve: Python ----------
import Rhino.Geometry as rg
if not E:
    E = 3
if not D:
    D = 0
try:
    if D:
        Crv = C.Trim(rg.CurveEnd(E), D)
    else:
        Crv = C
except:
    pass
# ---------- end trim_curve ----------
trim_curve_2 = TrimCurve(C=offset_2, D=chamfer)  # -> Crv; inputs C: Curve, D: Double, E: Int32; same code as trim_curve
trim_curve_3 = TrimCurve(C=ln_2, D=chamfer)  # -> Crv; inputs C: Curve, D: Double, E: Int32; same code as trim_curve
trim_curve_4 = TrimCurve(C=ln_3, D=chamfer)  # -> Crv; inputs C: Curve, D: Double, E: Int32; same code as trim_curve
divide_2 = DivideCurve(Curve=trim_curve_2, Count=x_segements, Kinks=False)  # -> reverse(Points), Tangents, Parameters
divide_3 = DivideCurve(Curve=trim_curve, Count=x_segements, Kinks=False)  # -> Points, Tangents, Parameters
divide_4 = DivideCurve(Curve=trim_curve_4, Count=y_segements, Kinks=False)  # -> Points, Tangents, Parameters
divide_5 = DivideCurve(Curve=trim_curve_3, Count=y_segements, Kinks=False)  # -> reverse(Points), Tangents, Parameters

# ---- group: Inner Convexity
move_4 = Move(Geometry=divide_2.Points, Motion=multiplication_4)  # -> Geometry, Transform

# ----
group = Group(Objects=divide_5.Points)
group_2 = Group(Objects=divide_3.Points)
group_3 = Group(Objects=move_4.Geometry)
group_4 = Group(Objects=divide_4.Points)
weave = Weave(Pattern=[0, 1, 2, 3], Stream0=group, Stream1=group_2, Stream2=group_4, Stream3=group_3, NullGaps=False)
ungroup = Ungroup(Group=weave)
pshift = ShiftPaths(Data=ungroup, Offset=-1)  # -> simplify(Data)
segment_points = ClusterOutput(pshift)

# ==== cluster Cluster_2
edge_points = ClusterInput()
edge_vector = ClusterInput()
chamfer = ClusterInput()
amp = Amplitude(Vector=edge_vector, Amplitude=chamfer)
move = Move(Geometry=edge_points, Motion=amp)  # -> Geometry, Transform
abs = Absolute(Value=chamfer)
pline = PolyLine(Vertices=move.Geometry, Closed=True)
offset = OffsetCurve(Curve=pline, Distance=expr("-x", abs), Corners=1)
crv_cp = CurveClosestPoint(Point=move.Geometry, Curve=offset)  # -> Point, Parameter, Distance
P = ClusterOutput(crv_cp.Point)
